# Dynamo graph WhatTheFlock.dyn (Dynamo 2.18.0.4827)
# packages: WhatTheFlock 1.0.0.0

create = WhatTheFlock.ZeroTouch.WhatTheFlock.Create()
agent_count = IntegerSlider(20000, range=0..50000 step 1)
is3D = BoolSelector(true)
iterations = IntegerSlider(1, range=0..1000 step 1)
reset = BoolSelector(true)
execute = BoolSelector(true)
bounding_box_size = DoubleSlider(35, range=0..70 step 1)
time_step = DoubleSlider(0.01, range=0..0.01 step 0.001)
neighborhood_radius = DoubleSlider(2, range=0..10 step 0.01)
alignment_strength = DoubleSlider(10, range=0..20 step 0.1)
cohesion_strength = DoubleSlider(5, range=0..20 step 0.1)
separation_strength = DoubleSlider(5, range=0..20 step 0.1)
separation_distance = DoubleSlider(1, range=0.1..5 step 0.1)
agent_displayed_length = DoubleSlider(0.7, range=0..5 step 0.01)
agent_displayed_width = DoubleSlider(0.4, range=0..2 step 0.01)
# note: HOW TO START:
# 1. Set the "reset" input to "True" (if it is not already so)
# 2. Then set it to "False", and make sure the "execute" input is "True". You should see the flocking simulation running.
# NOTE:
# While the simulation is running, you can change all the parameres interactively.
# Two exceptions are "is3D" and "agentCount" parameters. Whenver you make changes to these parameters, you have to reset the simulation (by settings "reset" input to "True" and then "False) so that they can take effect.
execute_2 = WhatTheFlock.ZeroTouch.WhatTheFlock.Execute(whatTheFlock=create, agentCount=agent_count, is3D=is3D, iterations=iterations, reset=reset, execute=execute, boundingBoxSize=bounding_box_size, timeStep=time_step, neighborhoodRadius=neighborhood_radius, alignmentStrength=alignment_strength, cohesionStrength=cohesion_strength, separationStrength=separation_strength, separationDistance=separation_distance, agentDisplayedLength=agent_displayed_length, agentDisplayedWidth=agent_displayed_width)
